# Grasshopper definition GhExcel_Sample.gh (Grasshopper 1.0.7)
# plug-ins: GhExcel

# ---- group: Inputs
_1_launch_excel = BooleanToggle(False)
_2_write_contents = BooleanToggle(False)
_3_read_contents = BooleanToggle(False)

# ----
# Basic Sample File
# GhExcel | Microsoft Excel Interoperability Plugin
# Copyright: 2025 CORE studio | Thornton Tomasetti
# Contact: CORE@ThorntonTomasetti.com
# Website: https://www.aectech.us/
xl_app = ExcelApplication(Activate=_1_launch_excel)
series = Series(Start=0, Step=1, Count=10)
multiplication = Multiplication(A=series, B=10)
xl_wbk = ExcelWorkbook(ExcelApplication=xl_app)
merge = Merge(Data1=graft(series), Data2=graft(multiplication))  # -> simplify(Result)
panel = Panel(xl_wbk)
xl_wks = ExcelWorksheet(ExcelWorkbook=xl_wbk)
flip = FlipMatrix(Data=merge)
panel_2 = Panel(xl_wks)
xl_rng = ExcelRange(ExcelWorksheet=xl_wks, StartingCell="B2", EndCell="C6")
xl_set = SetExcelData(ExcelWorksheet=xl_wks, Data=flip, StartingCell="B2", Activate=_2_write_contents)
panel_3 = Panel(xl_set)
panel_4 = Panel(xl_rng)
xl_get = GetExcelData(ExcelRange=xl_set, Activate=_3_read_contents)
xl_get_2 = GetExcelData(ExcelRange=xl_rng, Activate=_3_read_contents)
panel_5 = Panel(xl_get_2)
panel_6 = Panel(xl_get)
